# Grasshopper definition Vessels_V1.gh (Grasshopper 1.0.8)

py3 = Python3Script()  # -> out, heart, lines
# ---------- py3: Python ----------
import rhinoscriptsyntax as rs
import random
import math

# heart = [rs.AddSphere((0,0,0), 10), rs.AddCylinder((0,4,6), 6, 3), rs.AddCylinder((0,-4,6), 6, 3)]

# first_circles = [rs.AddCircle((0,4,12),3), rs.AddCircle((0,-4,12),3)]
# initial_plane = rs.PlaneFromNormal((0,0,9), (0,0,1))
# test_plane = rs.PlaneFromNormal((0,0,20), (0,1,0))
# test_circle = rs.AddCircle(test_plane, 3)

# vessels = rs.AddLoftSrf([first_circles[0], test_circle, first_circles[1]] , loft_type = 1, simplify_method=1)


# def recVesselGen(number_times, initial_circle, circle_plane):
#     rot_angle = random.randint(50,80)
#     rs.RotatePlane(circle_plane, rot_angle, )
#     # create vessel 1 @ random angle
#     # loft to initial_circle
#     # call recVesselGen @ end of vessel 1
#     # create vessel 2 oppposite vessel 1
#     # loft to initial_circle
#     # call recVesselGen @ end of vessel 2

heart = rs.AddSphere((0,0,0), 10)
lines = []

initial_point1 = [0,0,10]
# initial_point2 = [-10,-10,10]
# point_2 = [0,0,0]
vec_1 = [0,-5,5]
vec_2 = [0,5,5]




def RecGen(initial_point, final_point1, final_point2, times):
    if(times >= 8): return lines
    # Get initial point
    # Set Point 1
    #   Calculate vec_1
    #   Initial_point + vec_1
    pt1 = CalcVector(initial_point, final_point1, times)
    # print(pt1)
    if(pt1 != initial_point): lines.append(rs.AddLine(initial_point, pt1))
    if((CalcDist(pt1, final_point1) <= 20)): 
        print("point 1 reached")
        final_point1 = [0,0,-30]
    if((CalcDist(pt1, final_point1) <= 20) and (final_point1 == final_point2)): return lines
    # Add line initial point to Point 1
    # Set Point 2
    #   Calculate vec_2
    #   Initial_point + vec_2
    pt2 = CalcVector(initial_point, final_point2, times)
    if(pt2 != initial_point): lines.append(rs.AddLine(initial_point, pt2))
    if((CalcDist(pt2, final_point2) <= 20)): 
        print("point 2 reached")
        final_point2 = [0,0,-30]
    if((CalcDist(pt2, final_point2) <= 20) and (final_point1 == final_point2)): return lines
    # Add line initial point to Point 2
    RecGen(pt1, final_point1, final_point1, times+1 )
    RecGen(pt2, final_point2, final_point2, times+1 )
    # Repeat for point 1
    # Repeat for point 2
    # If distance between two points is minimal: connect 2 points and exit



def CalcVector(ini_point, final_point, times):
    rem_dist = CalcDist(ini_point, final_point)
    # print(ini_point)
    # print(final_point)
    # print("remaining distance: " + str(rem_dist))
    diff_vec = [((final_point[0] - ini_point[0])+random.uniform(-20+times, 20-times))/(rem_dist*0.1),
    ((final_point[1] - ini_point[1])+random.uniform(-20+times, 20-times))/(rem_dist*0.1), 
    ((final_point[2] - ini_point[2])+random.uniform(-20+times, 20-times))/(rem_dist*0.1)]
    if(times <= 2): diff_vec = [diff_vec[0], diff_vec[1], diff_vec[2] + 10-times*2]
    
    next_pt = [ini_point[0] + diff_vec[0], ini_point[1] + diff_vec[1], ini_point[2] + diff_vec[2]]
    
    if(CalcDist(next_pt, [0,0,0]) < 10):
        # print(next_pt)
        return ini_point
    else: return next_pt
    # Calculate distance and vect of ini_point to final_point for x,y,z, new function??
    # vector calculation with inital vector and final vector
    # if next_point is inside the heart, calculate again
    return [0,0,0]
def GetNewPoint(point, vect):
    return [point(0) + vect(0), point(1) + vect(1), point(2) + vect(2)]
def CalcDist(point1, point2):
    return math.sqrt((point1[0]-point2[0])**2 + (point2[1]-point1[1])**2 + (point1[2]-point2[2])**2)



RecGen(initial_point1, [20,20,-20], [-20,-20,-20], 0)
# ---------- end py3 ----------
panel = Panel(py3.lines)
